# Grasshopper definition 241210_BSE Test_Small beam.gh (Grasshopper 1.0.8)
# plug-ins: Karamba3D, BeamShapeExplorer, Radical

number_slider = Slider(0.15, range=0..1)
number_slider_2 = Slider(0.05, range=0.05..0.95)
number_slider_3 = Slider(0.29, range=0.05..0.95)  # disabled
number_slider_4 = Slider(0.041, range=0.03..0.15)  # disabled

number_slider_5 = Slider(0.07, range=0.05..0.95)  # disabled
number_slider_6 = Slider(0.1, range=0.05..0.95)  # disabled
number_slider_7 = Slider(0.06, range=0.05..0.95)  # disabled
panel = Panel("1")  # disabled
panel_2 = Panel("1")  # disabled
panel_3 = Panel("0")  # disabled
merge = Merge(Data1=panel_3, Data2=number_slider_6, Data3=number_slider_7, Data4=panel_2)  # disabled
merge_2 = Merge(Data1=panel, Data2=panel, Data3=number_slider_5, Data4=number_slider_3)  # disabled
section_builder = SectionBuilder(
    WidthMOfSectionB=number_slider,
    DepthMOfSectionH=number_slider_4,
    VariableXCoefficients=merge_2,
    VariableYCoefficients=merge)  # -> Pts, Crv, VariableSection; disabled

number_slider_8 = Slider(0.09, range=0.05..0.95)  # disabled
number_slider_9 = Slider(0.032, range=0.03..0.095)  # disabled

number_slider_10 = Slider(0.2, range=0.05..0.95)  # disabled
number_slider_11 = Slider(0.56, range=0.05..0.95)  # disabled
number_slider_12 = Slider(0.09, range=0.05..0.95)  # disabled
panel_4 = Panel("1")  # disabled
panel_5 = Panel("1")  # disabled
panel_6 = Panel("0")  # disabled
merge_3 = Merge(Data1=panel_4, Data2=panel_4, Data3=number_slider_10, Data4=number_slider_8)  # disabled
merge_4 = Merge(Data1=panel_6, Data2=number_slider_11, Data3=number_slider_12, Data4=panel_5)  # disabled
section_builder_2 = SectionBuilder(
    WidthMOfSectionB=number_slider,
    DepthMOfSectionH=number_slider_9,
    VariableXCoefficients=merge_3,
    VariableYCoefficients=merge_4)  # -> Pts, Crv, VariableSection; disabled

number_slider_13 = Slider(0.115, range=0.03..0.15)

number_slider_14 = Slider(0.05, range=0.05..0.95)
number_slider_15 = Slider(0.07, range=0.05..0.95)
number_slider_16 = Slider(0.05, range=0.05..0.95)
merge_5 = Merge(Data1="0", Data2=number_slider_15, Data3=number_slider_16, Data4="1")
merge_6 = Merge(Data1="1", Data2="1", Data3=number_slider_14, Data4=number_slider_2)
section_builder_3 = SectionBuilder(
    WidthMOfSectionB=number_slider,
    DepthMOfSectionH=number_slider_13,
    VariableXCoefficients=merge_6,
    VariableYCoefficients=merge_5)  # -> Pts, Crv, VariableSection

number_slider_17 = Slider(0.29, range=0.05..0.95)

number_slider_18 = Slider(0.29, range=0.05..0.95)
number_slider_19 = Slider(0.09, range=0.05..0.95)
number_slider_20 = Slider(0.089, range=0.03..0.15)
number_slider_21 = Slider(0.05, range=0.05..0.95)
merge_7 = Merge(Data1="0", Data2=number_slider_19, Data3=number_slider_21, Data4="1")
merge_8 = Merge(Data1="1", Data2="1", Data3=number_slider_18, Data4=number_slider_17)
section_builder_4 = SectionBuilder(
    WidthMOfSectionB=number_slider,
    DepthMOfSectionH=number_slider_20,
    VariableXCoefficients=merge_8,
    VariableYCoefficients=merge_7)  # -> Pts, Crv, VariableSection

# ---- group: Global settings (right click to recompute)
select_code = SelectCode(BuildingCode0IS4561ACI318=Slider(1, range=0..1))
material_properties_global = MaterialPropertiesGlobal(
    ConcreteCharacteristicStrengthMPaNMm2=Slider(27, range=0..100),
    ConcreteEModulusMPaNMm2=27500,
    ConcreteMaximumStrainMmMm=0.0035,
    ConcreteDensityKgM3=2400,
    ConcreteCostUnitKg=Slider(0.11, range=0..1),
    SteelCharacteristicStrengthMPaNMm2=415,
    SteelEModulusMPaNMm2=205000,
    SteelMaximumStrainMmMm=0.004,
    SteelDensityKgM3=8050,
    SteelCostUnitKg=Slider(0.84, range=0..1))
panel_7 = Panel(select_code)

# ----
merge_9 = Merge(
    Data1=section_builder_4.VariableSection,
    Data2=section_builder_3.VariableSection,
    Data3=section_builder_4.VariableSection,
    Data4=section_builder_2.VariableSection)
merge_10 = Merge(Data1=number_slider_19, Data2=number_slider_15, Data3=number_slider_6, Data4=number_slider_11)
merge_11 = Merge(Data1=number_slider_20, Data2=number_slider_13, Data3=number_slider_4, Data4=number_slider_9)

merge_12 = Merge(Data1=number_slider_18, Data2=number_slider_14, Data3=number_slider_5, Data4=number_slider_10)
merge_13 = Merge(Data1=number_slider_17, Data2=number_slider_2, Data3=number_slider_3, Data4=number_slider_8)
subtraction = Subtraction(A=merge_12, B=merge_13)

multiplication = Multiplication(A=merge_11, B=merge_10)
beam_builder = BeamBuilder(SpanM=Slider(0.76, range=0..1), VariableSectionObjects=merge_9)  # -> ConstructionPlanes, VariablePoints, VariableCurves, BeamBrep, SpanCurve
panel_8 = Panel(multiplication)
number_slider_22 = Slider(20, range=0..20)
expression = Expression(val=multiplication, test=Slider(0.008, range=0..0.01), Expression="abs(val)-abs(test)")
read_mp = ReadMP()
number_slider_23 = Slider(0, range=0..1)
curve = Curve(beam_builder.SpanCurve)
brep = Brep(beam_builder.BeamBrep)
load_envelope_from_selfweight = LoadEnvelopeFromSelfweight(
    MaterialProperties=read_mp,
    BeamBRep=brep,
    SpanCurve=curve,
    NumberOfAnalysisSections=number_slider_22,
    GraphScale=Slider(0.5, range=0..1))  # -> DistributedLoadEnvelopeKNM, SplitCurve, DistributedLoadGraphActual, DistributedLoadGraphAverage, ElementSegments
end_points = EndPoints(Curve=load_envelope_from_selfweight.SplitCurve)  # -> Start, End
list_item = ListItem(List=end_points.Start, Index=Slider(0, range=0..20), Wrap=True)
list_item_2 = ListItem(List=end_points.End, Index=Slider(19, range=0..20), Wrap=True)
expression_2 = Expression(LL=Slider(10, range=0..10), DL=load_envelope_from_selfweight.DistributedLoadEnvelopeKNM, Expression="1.2*DL-1.6*LL")
series = Series(Start=0, Step=1, Count=number_slider_22)
negative = Negative(Value=Slider(3, range=0..10))

panel_9 = Panel("-0.5")
unit_z = UnitZ(Factor=negative)
list_item_3 = ListItem(List=end_points.Start, Index=Slider(16, range=0..20), Wrap=True)
list_item_4 = ListItem(List=end_points.Start, Index=Slider(10, range=0..20), Wrap=True)
loads_karamba3d = Loads(ForceVector=unit_z, Local=False, PosInd=list_item_3, LCase="0", mode="Point")
loads_karamba3d_2 = Loads(ForceVector=unit_z, Local=False, PosInd=list_item_4, LCase="0", mode="Point")

curve_2 = Curve(load_envelope_from_selfweight.SplitCurve)
concatenate = Concatenate(FragmentA="beam_", FragmentB=series)
panel_10 = Panel(load_envelope_from_selfweight.DistributedLoadEnvelopeKNM)
unit_z_2 = UnitZ(Factor=expression_2)
panel_11 = Panel(expression_2)
line_to_beam_karamba3d = LineToBeam(
    Line=curve_2,
    Identifier=concatenate,
    New=True,
    Remove=True,
    LimitDistance_m=0.005,
    Bending=True,
    SetBucklingLength=True,
    ToPolylineMaxAngle=0.03,
    ToPolylineTolerance=0.01,
    ToPolylineMaxEdgeLength=0.25)  # -> Element, Points, Info
support_karamba3d = Supp(PosInd=list_item, menu=[buttons(on, on, on, on, off, on)])
support_karamba3d_2 = Supp(PosInd=list_item_2, menu=[buttons(off, off, on, off, off, off)])
beam_loads_karamba3d = BeamLoads(
    BeamIdentifier=concatenate,
    LoadCase="0",
    ForceVector=unit_z_2,
    TStart=0,
    TEnd=1,
    mode="Block",
    menu=[buttons(off, on, off)])  # -> flatten(Load)
load = LoadKaramba3D(flatten(beam_loads_karamba3d))
assemble_model_karamba3d = Assemble(
    Elem=line_to_beam_karamba3d.Element,
    Support=flatten([support_karamba3d, support_karamba3d_2]),
    Load=flatten(load),
    LimitDistance_m=0.005)  # -> Model, Info, Mass_kg, CentreOfGravity, LoadCaseNames
panel_12 = Panel(load)
analyze_karamba3d = Analyze(Model=assemble_model_karamba3d.Model)  # -> CalculatedModel, MaximumDisplacement_cm, ResultingForceOfGravity_kN, ElasticEnergyChange_kNm
model_view_karamba3d = ModelView(Model=analyze_karamba3d.CalculatedModel, ResultFactors=1, ResultCase=-1)  # -> Model, DeformedMesh, DeformedAxes, DeformedModel
beam_view_karamba3d = BeamView(Model=model_view_karamba3d.Model)  # -> Model, MeshesOfRenderedBeams, DeformedBeamAxes, LegendColours, LegendTags
curve_3 = Curve(beam_view_karamba3d.DeformedBeamAxes)
number_slider_24 = Slider(0, range=0..100)
dispatch = Dispatch(List=curve_3, DispatchPattern=[True, False])  # -> ListA, ListB
beam_forces_karamba3d = BForces(AnalysedModel=beam_view_karamba3d.Model, Ts=[0, 1])  # -> Model, NormalForce_kN, ShearForceVz_kN, ShearForceVy_kN, TorsionalMomentMt_kNm, BendingMomentMy_kNm, BendingMomentMz_kNm, LoadCaseIndex
boolean_toggle = BooleanToggle(False)
curve_4 = Curve(dispatch.ListA)
curve_5 = Curve(dispatch.ListB)
connect_curves = ConnectCurves(Curves=curve_5, Continuity=number_slider_24, Close=boolean_toggle, Bulge=1)
connect_curves_2 = ConnectCurves(Curves=curve_4, Continuity=number_slider_24, Close=boolean_toggle, Bulge=1)
bounds = Bounds(Numbers=flatten(beam_forces_karamba3d.BendingMomentMy_kNm))
bounds_2 = Bounds(Numbers=flatten(beam_forces_karamba3d.ShearForceVz_kN))
curve_6 = Curve(beam_builder.SpanCurve)
brep_2 = Brep(beam_builder.BeamBrep)
load_envelope_from_curves = LoadEnvelopeFromCurves(
    ShearCurve=connect_curves_2,
    MomentCurve=connect_curves,
    ShearDomain=bounds_2,
    MomentDomain=bounds,
    SpanCurve=curve_6,
    NumberOfAnalysisSections=Slider(10, range=0..100))  # -> ShearEnvelopeKN, MomentEnvelopeKNM, ShearAndMomentGraphs
number_slider_25 = Slider(200, range=0..1000)
read_mp_2 = ReadMP()
beam_sections = BeamSections(
    MaterialProperties=read_mp_2,
    MomentEnvelopeKNM=load_envelope_from_curves.MomentEnvelopeKNM,
    BeamBRep=brep_2,
    SpanCurve=curve_6,
    ClearCoverMm=Slider(35, range=0..100),
    AreaOfSteelMm2=Slider(71, range=0..100),
    ConstantAreaOfSteel=Toggle(True))  # -> ConcreteSections, SteelReinforcementSections
offset_curve = OffsetCurve(Curve=beam_sections.SteelReinforcementSections, Distance=Slider(0.01, range=0..0.01), Corners=1)
loft = Loft(
    Curves=flatten(offset_curve),
    Options={Adjust=False, Closed=False, LoftEnds=0, LoftSimp=0, LoftType=0, Rebuild=10, Refit=0.01})

brep_3 = Brep([beam_builder.BeamBrep, loft])
curve_7 = Curve(beam_builder.SpanCurve)

curve_curve = CurveCurve(CurveA=beam_sections.ConcreteSections, CurveB=offset_curve)  # -> flatten(Points), ParamsA, ParamsB; disabled
ductility_analysis = DuctilityAnalysis(
    MaterialProperties=read_mp_2,
    ConcreteSection=beam_sections.ConcreteSections,
    SteelSection=beam_sections.SteelReinforcementSections,
    ClearCoverMm=30,
    SectionSubdivisions=15)  # -> ReinforcementRatio, BwCrv, DistanceToTensileReinforcementM, MaxReinforcementRatio, MinReinforcementRatio
shear_analysis = ShearAnalysis(
    MaterialProperties=read_mp_2,
    MomentEnvelopeKNM=load_envelope_from_curves.MomentEnvelopeKNM,
    ShearEnvelopeKN=load_envelope_from_curves.ShearEnvelopeKN,
    DesignShearReinforcementKN=0,
    ConcreteSection=beam_sections.ConcreteSections,
    SteelSection=beam_sections.SteelReinforcementSections,
    ClearCoverMm=30,
    SectionSubdivisions=15)  # -> ShearCapacityKN, BwCrv
flexural_analysis_v2 = FlexuralAnalysisV2(
    MaterialProperties=read_mp_2,
    MomentEnvelopeKNM=load_envelope_from_curves.MomentEnvelopeKNM,
    ConcreteSection=beam_sections.ConcreteSections,
    SteelSection=beam_sections.SteelReinforcementSections,
    SectionSubdivisions=15)  # -> MomentCapacityKNM, CompressionArea, CompressionArea_2, Centroid

# ---- group: 2 pt load capacity
panel_13 = Panel(flexural_analysis_v2.MomentCapacityKNM)
division = Division(A=panel_13, B=Slider(0.254, range=0..1))
multiplication_2 = Multiplication(A=division, B=2)
panel_14 = Panel(multiplication_2)

# ----
multiplication_3 = Multiplication(A=multiplication_2, B=224)
panel_15 = Panel(multiplication_3)
total_cost = TotalCost(
    MaterialProperties=read_mp_2,
    ConcreteSection=beam_sections.ConcreteSections,
    SteelSection=beam_sections.SteelReinforcementSections)  # -> TotalCost, TotalMassKg, SteelAndConcreteBreps
list_length = ListLength(List=curve_curve.Points)  # disabled
negative_2 = Negative(Value=list_length)  # disabled
panel_16 = Panel([total_cost.TotalCost, total_cost.TotalMassKg])
expression_3 = Expression(
    val=ductility_analysis.ReinforcementRatio,
    test=ductility_analysis.MinReinforcementRatio,
    Expression="abs(val)-abs(test)")
expression_4 = Expression(
    val=ductility_analysis.ReinforcementRatio,
    test=ductility_analysis.MaxReinforcementRatio,
    Expression="abs(test)-abs(val)")
expression_5 = Expression(val=shear_analysis.ShearCapacityKN, test=load_envelope_from_curves.ShearEnvelopeKN, Expression="abs(val)-abs(test)")
expression_6 = Expression(
    val=flexural_analysis_v2.MomentCapacityKNM,
    test=load_envelope_from_curves.MomentEnvelopeKNM,
    Expression="abs(val)-abs(test)")
division_2 = Division(A=shear_analysis.ShearCapacityKN, B=2)
panel_18 = Panel(expression_5)
panel_19 = Panel(expression_4)
number = Number([number_slider_20, number_slider_18, number_slider_17, number_slider_19, number_slider_21, number_slider_14, number_slider_2, number_slider_15, number_slider_16, number_slider_5, number_slider_3, number_slider_6, number_slider_7, number_slider_10, number_slider_8, number_slider_11, number_slider_12])
panel_20 = Panel(expression_6)
panel_21 = Panel(expression_3)
num = Number(flatten([expression_5, expression_6, expression_3, expression_4, subtraction, negative_2, expression]))
radical = Radical(
    Objective=total_cost.TotalCost,
    Constraints=num,
    NumericalVariables=[number_slider_20, number_slider_18, number_slider_17, number_slider_19, number_slider_21, number_slider_14, number_slider_2, number_slider_15, number_slider_16, number_slider_5, number_slider_3, number_slider_6, number_slider_7, number_slider_10, number_slider_8, number_slider_11, number_slider_12, number_slider_13, number_slider_4, number_slider_9])  # -> ObjectiveEvolution, VariableEvolution, GradientEvolution
panel_22 = Panel(num)
